# Grasshopper definition PavilionOne.gh (Grasshopper 0.9.76)
# plug-ins: Kangaroo Components, PTComponentLibrary, Weaverbird, Kangaroo2 Components

# ---- group: XTranslationControlWatchOutItShouldMatchTheTranslationsThatAreBelowCheckByViewingTheRedWatchOutGroupToTheRight
number_slider = Slider(9, range=0..30)

# ---- group: GridFourOurValleysAndMountains
planar_grid = PlanarGrid(
    BasePoint=Point(0, 0, 0),
    IDir=Vector(1, 0, 0),
    JDir=Vector(0, 1, 0),
    IDistance=Slider(4.3265, range=0..10),
    JDistance=Slider(3.44, range=0..10),
    INumber=6,
    JNumber=number_slider)  # -> simplify(Grid)

# ---- group: MeasureSizeOfGrid
list_item = ListItem(List=flatten(planar_grid), Index=Slider(8, range=0..100), Wrap=True)
list_item_2 = ListItem(List=flatten(planar_grid), Index=Slider(45, range=0..100), Wrap=True)
list_item_3 = ListItem(List=flatten(planar_grid), Index=Slider(0, range=0..100), Wrap=True)
distance = Distance(PointA=list_item_3, PointB=list_item)
distance_2 = Distance(PointA=list_item_3, PointB=list_item_2)
panel = Panel(distance_2)
panel_2 = Panel(distance)

# ----
boolean_toggle = BooleanToggle(False)  # disabled

# ---- group: SetUpOurMeshAndTheTranslations
number_slider_2 = Slider(0, range=0..7)
number_slider_3 = Slider(5, range=0..7)
pickarowwithoutloosingbranch = CSharpScript(tree=planar_grid, branch=number_slider_2)  # -> selected; inputs tree: tree of Point3d, branch: Int32
# ---------- pickarowwithoutloosingbranch: C# ----------
    var treeOut = new DataTree<Point3d>();
    
    var size = tree.BranchCount;
    
    for( int i = branch; i < branch + 1; ++i )
      for( int j = 0; j < tree.Branch(i).Count; ++j )
      {
      
        treeOut.Add( tree.Branch(i)[j], new GH_Path( i ) );
      
      }
    
    selected = treeOut;
# ---------- end pickarowwithoutloosingbranch ----------
pickarowwithoutloosingbranch_2 = CSharpScript(tree=planar_grid, branch=number_slider_3)  # -> selected; inputs tree: tree of Point3d, branch: Int32; same code as pickarowwithoutloosingbranch
unit_y = UnitY(Factor=Slider(0, range=0..10))
move = Move(Geometry=pickarowwithoutloosingbranch, Motion=expr("-x", unit_y))  # -> Geometry, Transform
pickarowwithoutloosingbranch_3 = CSharpScript(tree=planar_grid, branch=Slider(4, range=0..7))  # -> selected; inputs tree: tree of Point3d, branch: Int32; same code as pickarowwithoutloosingbranch
pickarowwithoutloosingbranch_4 = CSharpScript(tree=planar_grid, branch=Slider(3, range=0..7))  # -> selected; inputs tree: tree of Point3d, branch: Int32; same code as pickarowwithoutloosingbranch
pickarowwithoutloosingbranch_5 = CSharpScript(tree=planar_grid, branch=Slider(2, range=0..7))  # -> selected; inputs tree: tree of Point3d, branch: Int32; same code as pickarowwithoutloosingbranch
unit_y_2 = UnitY(Factor=Slider(0, range=-10..10))
pickarowwithoutloosingbranch_6 = CSharpScript(tree=planar_grid, branch=Slider(1, range=0..7))  # -> selected; inputs tree: tree of Point3d, branch: Int32; same code as pickarowwithoutloosingbranch
number_slider_4 = Slider(22, range=0..100)
number_slider_5 = Slider(21, range=0..100)
number_slider_6 = Slider(7, range=0..10)
number_slider_7 = Slider(5, range=0..10)
number_slider_8 = Slider(24, range=0..100)
number_slider_9 = Slider(2, range=0..10)
number_slider_10 = Slider(7, range=0..10)
number_slider_11 = Slider(6, range=0..100)
number_slider_12 = Slider(2, range=0..10)
number_slider_13 = Slider(4, range=0..10)
number_slider_14 = Slider(3, range=0..50)
number_slider_15 = Slider(32, range=0..100)
number_slider_16 = Slider(28, range=0..100)
move_2 = Move(Geometry=pickarowwithoutloosingbranch_2, Motion=unit_y_2)  # -> Geometry, Transform
number_slider_17 = Slider(21, range=0..100)
unit_y_3 = UnitY(Factor=Slider(0, range=-2..2))
unit_y_4 = UnitY(Factor=[Slider(-1.706, range=-4..1), Slider(-2.254, range=-4..2), Slider(-3.36, range=-4..4)])
list_item_4 = ListItem(List=move_2.Geometry, Index=number_slider_4, Wrap=True)
unit_y_5 = UnitY(Factor=[Slider(0.062, range=-1..1), Slider(-1.06, range=-2..2)])
unit_y_6 = UnitY(Factor=[Slider(0, range=0..2), Slider(0.88, range=-5..5.001)])
list_item_5 = ListItem(List=pickarowwithoutloosingbranch_3, Index=[number_slider_5, number_slider_7, number_slider_6], Wrap=True)
list_item_6 = ListItem(List=pickarowwithoutloosingbranch_4, Index=[number_slider_8, number_slider_9], Wrap=True)
cull_index = CullIndex(List=move_2.Geometry, Indices=number_slider_4, Wrap=True)
list_item_7 = ListItem(List=pickarowwithoutloosingbranch_5, Index=[number_slider_11, number_slider_13], Wrap=True)
cull_index_2 = CullIndex(List=pickarowwithoutloosingbranch_3, Indices=[number_slider_5, number_slider_7, number_slider_6], Wrap=True)
unit_y_7 = UnitY(Factor=[Slider(1.358, range=-1..3), Slider(3, range=-2..3), Slider(2, range=-4..4)])
cull_index_3 = CullIndex(List=pickarowwithoutloosingbranch_4, Indices=[number_slider_8, number_slider_9], Wrap=True)
cull_index_4 = CullIndex(List=pickarowwithoutloosingbranch_5, Indices=[number_slider_11, number_slider_13], Wrap=True)
list_item_8 = ListItem(List=pickarowwithoutloosingbranch_6, Index=[number_slider_15, number_slider_14, number_slider_16], Wrap=True)
unit_y_8 = UnitY(Factor=Slider(0, range=-2..2))
cull_index_5 = CullIndex(List=pickarowwithoutloosingbranch_6, Indices=[number_slider_15, number_slider_14, number_slider_16], Wrap=True)
list_item_9 = ListItem(List=move.Geometry, Index=number_slider_17, Wrap=True)
cull_index_6 = CullIndex(List=move.Geometry, Indices=number_slider_17, Wrap=True)
move_3 = Move(Geometry=list_item_4, Motion=expr("-x", unit_y_3))  # -> Geometry, Transform
move_4 = Move(Geometry=list_item_5, Motion=expr("-x", unit_y_4))  # -> Geometry, Transform
move_5 = Move(Geometry=list_item_6, Motion=expr("-x", unit_y_5))  # -> Geometry, Transform
path_mapper = PathMapper(cull_index, source="{A;B}", target="{A}")
move_6 = Move(Geometry=list_item_7, Motion=unit_y_6)  # -> Geometry, Transform
path_mapper_2 = PathMapper(cull_index_2, source="{A;B}", target="{A}")
move_7 = Move(Geometry=list_item_8, Motion=expr("-x", unit_y_7))  # -> Geometry, Transform
path_mapper_3 = PathMapper(cull_index_3, source="{A;B}", target="{A}")
path_mapper_4 = PathMapper(cull_index_4, source="{A;B}", target="{A}")
move_8 = Move(Geometry=list_item_9, Motion=expr("-x", unit_y_8))  # -> Geometry, Transform
path_mapper_5 = PathMapper(cull_index_5, source="{A;B}", target="{A}")
path_mapper_6 = PathMapper(cull_index_6, source="{A;B}", target="{A}")
point = Point([path_mapper, move_3.Geometry])
point_2 = Point([path_mapper_2, move_4.Geometry])
point_3 = Point([path_mapper_3, move_5.Geometry])
point_4 = Point([path_mapper_4, move_6.Geometry])
point_5 = Point([path_mapper_5, move_7.Geometry])
point_6 = Point([path_mapper_6, move_8.Geometry])
sort_points = SortPoints(Points=point)  # -> Points, Indices
sort_points_2 = SortPoints(Points=point_2)  # -> Points, Indices
sort_points_3 = SortPoints(Points=point_3)  # -> Points, Indices
sort_points_4 = SortPoints(Points=point_4)  # -> Points, Indices
sort_points_5 = SortPoints(Points=point_5)  # -> Points, Indices
sort_points_6 = SortPoints(Points=point_6)  # -> Points, Indices
point_list = PointList(Points=sort_points_2.Points)
point_list_2 = PointList(Points=sort_points_3.Points)
merge = Merge(
    Data1=sort_points_6.Points,
    Data2=sort_points_5.Points,
    Data3=sort_points_4.Points,
    Data4=sort_points_3.Points,
    Data5=sort_points_2.Points,
    Data6=sort_points.Points)

# ----
pickarowwithoutloosingbranch_7 = CSharpScript(tree=planar_grid, branchStart=number_slider_2, branchEnd=number_slider_3, randomOrNot=boolean_toggle)  # -> selected; inputs tree: tree of Point3d, branchStart: Int32, branchEnd: Int32, randomOrNot: Boolean; disabled
# ---------- pickarowwithoutloosingbranch_7: C# ----------
    var treeOut = new DataTree<Point3d>();

    var size = tree.BranchCount;

    for( int i = branchStart + 1; i < branchEnd; ++i )
      for( int j = 0; j < tree.Branch(i).Count; ++j )
      {

        if( randomOrNot == false )
        {

          if( i != 2 && i != 3 )


            treeOut.Add(tree.Branch(i)[j], new GH_Path(i));

        }

        else
        {

          //if( i != 2 && i != 3 && i != 4 && i != 5 )


          treeOut.Add(tree.Branch(i)[j], new GH_Path(i));

        }

      }

    selected = treeOut;
# ---------- end pickarowwithoutloosingbranch_7 ----------

# ---- group: Attractors
point_7 = Point(merge)
number_slider_18 = Slider(0.228, range=0..1)
curve = Curve(<curve referenced from the Rhino model>)
point_8 = Point(Point(42.54006911, -14.3092749, 0))
point_9 = Point(<point referenced from the Rhino model>)
spin_force = SpinForce(
    Plane=point_8,
    Strength=expr("-x", Slider(10, range=0..10)),
    Radius=Slider(10, range=0..10),
    Decay=Slider(1.216, range=0..10))
spin_force_2 = SpinForce(
    Plane=point_9,
    Strength=expr("-x", Slider(4.5498, range=0..100)),
    Radius=Slider(10, range=0..10),
    Decay=Slider(0, range=0..10))
merge_fields = MergeFields(Fields=flatten(spin_force_2))
evaluate_field = EvaluateField(Field=merge_fields, Point=point_7)  # -> Tensor, Strength
point_10 = Point([<point referenced from the Rhino model> x2])
random_attraction = RandomAttraction(Grid=point_7, Magnitude=number_slider_18)  # -> simplify(Grid), Weights
curve_attraction = CurveAttraction(Grid=point_7, CrvAtts=curve, Magnitude=number_slider_18)  # -> simplify(Grid), Weights
point_attraction = PointAttraction(Grid=point_7, PtAtts=point_10, Magnitude=Slider(1, range=0..1))  # -> simplify(Grid), Weights
move_9 = Move(Geometry=point_7, Motion=evaluate_field.Tensor)  # -> Geometry, Transform
point_11 = Point(point_7)

# ---- group: ParametricMagicThanksRelativeItem
boolean_toggle_2 = BooleanToggle(False)
flip_matrix = FlipMatrix(Data=point_attraction.Grid)
relative_item = RelativeItem(Tree=point_attraction.Grid, Offset="{0}[+1]", WrapPaths=boolean_toggle_2, WrapItems=boolean_toggle_2)  # -> ItemA, ItemB
relative_item_2 = RelativeItem(Tree=flip_matrix, Offset="{0}[+1]", WrapPaths=boolean_toggle_2, WrapItems=boolean_toggle_2)  # -> ItemA, ItemB
relative_item_3 = RelativeItem(Tree=point_attraction.Grid, Offset="{+1}[+1]", WrapPaths=boolean_toggle_2, WrapItems=boolean_toggle_2)  # -> ItemA, ItemB
relative_item_4 = RelativeItem(Tree=point_attraction.Grid, Offset="{+1}[-1]", WrapPaths=boolean_toggle_2, WrapItems=boolean_toggle_2)  # -> ItemA, ItemB
line = Line(StartPoint=relative_item.ItemA, EndPoint=relative_item.ItemB)
line_2 = Line(StartPoint=relative_item_4.ItemA, EndPoint=relative_item_4.ItemB)
line_3 = Line(StartPoint=relative_item_2.ItemA, EndPoint=relative_item_2.ItemB)
line_4 = Line(StartPoint=relative_item_3.ItemA, EndPoint=relative_item_3.ItemB)
boolean_toggle_3 = BooleanToggle(False)
relative_item_5 = RelativeItem(Tree=line_4, Offset="{+2}[0]", WrapPaths=boolean_toggle_3, WrapItems=boolean_toggle_3)  # -> ItemA, ItemB
relative_item_6 = RelativeItem(Tree=line_2, Offset="{+2}[0]", WrapPaths=boolean_toggle_3, WrapItems=boolean_toggle_3)  # -> ItemA, ItemB
relative_item_7 = RelativeItem(Tree=line_3, Offset="{+2}[0]", WrapPaths=boolean_toggle_3, WrapItems=boolean_toggle_3)  # -> ItemA, ItemB
relative_item_8 = RelativeItem(Tree=line, Offset="{+2}[0]", WrapPaths=boolean_toggle_3, WrapItems=boolean_toggle_3)  # -> ItemA, ItemB
boolean_toggle_4 = BooleanToggle(False)
line_5 = Line(relative_item_6.ItemB)
line_6 = Line(relative_item_6.ItemA)
line_7 = Line(relative_item_5.ItemB)
line_8 = Line(relative_item_5.ItemA)
line_9 = Line(relative_item_7.ItemB)
line_10 = Line(relative_item_7.ItemA)
line_11 = Line(relative_item_8.ItemB)
line_12 = Line(relative_item_8.ItemA)
relative_item_9 = RelativeItem(Tree=line_9, Offset="{+1}[0]", WrapPaths=boolean_toggle_4, WrapItems=boolean_toggle_4)  # -> ItemA, ItemB
relative_item_10 = RelativeItem(Tree=line_11, Offset="{+1}[0]", WrapPaths=boolean_toggle_4, WrapItems=boolean_toggle_4)  # -> ItemA, ItemB
relative_item_11 = RelativeItem(Tree=line_10, Offset="{+1}[0]", WrapPaths=boolean_toggle_4, WrapItems=boolean_toggle_4)  # -> ItemA, ItemB
relative_item_12 = RelativeItem(Tree=line_12, Offset="{+1}[0]", WrapPaths=boolean_toggle_4, WrapItems=boolean_toggle_4)  # -> ItemA, ItemB
relative_item_13 = RelativeItem(Tree=line_8, Offset="{+1}[0]", WrapPaths=boolean_toggle_4, WrapItems=boolean_toggle_4)  # -> ItemA, ItemB
relative_item_14 = RelativeItem(Tree=line_7, Offset="{+1}[0]", WrapPaths=boolean_toggle_4, WrapItems=boolean_toggle_4)  # -> ItemA, ItemB
relative_item_15 = RelativeItem(Tree=line_6, Offset="{+1}[0]", WrapPaths=boolean_toggle_4, WrapItems=boolean_toggle_4)  # -> ItemA, ItemB
relative_item_16 = RelativeItem(Tree=line_5, Offset="{+1}[0]", WrapPaths=boolean_toggle_4, WrapItems=boolean_toggle_4)  # -> ItemA, ItemB
line_13 = Line(relative_item_9.ItemB)
line_14 = Line(relative_item_10.ItemB)
line_15 = Line(relative_item_11.ItemA)
line_16 = Line(relative_item_12.ItemA)
line_17 = Line(relative_item_13.ItemB)
line_18 = Line(relative_item_14.ItemA)
line_19 = Line(relative_item_15.ItemB)
line_20 = Line(relative_item_16.ItemA)
flip_matrix_2 = FlipMatrix(Data=line_13)
flip_matrix_3 = FlipMatrix(Data=line_14)
flip_matrix_4 = FlipMatrix(Data=line_15)
flip_matrix_5 = FlipMatrix(Data=line_16)
cull_pattern = CullPattern(List=line_17, CullPattern=[False, True])
cull_pattern_2 = CullPattern(List=line_18, CullPattern=invert([False, True]))
cull_pattern_3 = CullPattern(List=line_19, CullPattern=invert([False, True]))
cull_pattern_4 = CullPattern(List=line_20, CullPattern=[False, True])
list_item_10 = ListItem(List=flip_matrix_3, Index=Slider(5, range=0..10), Wrap=True)
list_item_11 = ListItem(List=flip_matrix_4, Index=0, Wrap=True)
list_item_12 = ListItem(List=flip_matrix_5, Index=0, Wrap=True)
list_item_13 = ListItem(List=flip_matrix_2, Index=Slider(5, range=0..10), Wrap=True)
flip_matrix_6 = FlipMatrix(Data=cull_pattern)
flip_matrix_7 = FlipMatrix(Data=cull_pattern_2)
flip_matrix_8 = FlipMatrix(Data=cull_pattern_3)
flip_matrix_9 = FlipMatrix(Data=cull_pattern_4)

# ---- group: Borders
flip_matrix_10 = FlipMatrix(Data=point_attraction.Grid)
flip_matrix_11 = FlipMatrix(Data=point_attraction.Grid)
pickarowwithoutloosingbranch_8 = CSharpScript(tree=flip_matrix_10, branch=Slider(0, range=0..100))  # -> selected; inputs tree: tree of Point3d, branch: Int32; same code as pickarowwithoutloosingbranch
pickarowwithoutloosingbranch_9 = CSharpScript(tree=flip_matrix_11, branch=Slider(8, range=0..100))  # -> selected; inputs tree: tree of Point3d, branch: Int32; same code as pickarowwithoutloosingbranch
cull_pattern_5 = CullPattern(List=pickarowwithoutloosingbranch_8, CullPattern=[True, False, True, True, False])
cull_pattern_6 = CullPattern(List=pickarowwithoutloosingbranch_9, CullPattern=[True, False, True, True, False])
join_curves = JoinCurves(Curves=flatten(list_item_11), Preserve=False)
join_curves_2 = JoinCurves(Curves=flatten(list_item_13), Preserve=False)
curve_closest_point = CurveClosestPoint(Point=cull_pattern_5, Curve=join_curves)  # -> Point, Parameter, Distance
curve_closest_point_2 = CurveClosestPoint(Point=cull_pattern_6, Curve=join_curves_2)  # -> Point, Parameter, Distance
shatter = Shatter(Curve=join_curves, Parameters=curve_closest_point.Parameter)
shatter_2 = Shatter(Curve=join_curves_2, Parameters=curve_closest_point_2.Parameter)

# ----
centerlines = CSharpScript(lines=line_3)  # -> linesOut; inputs lines: tree of Line
# ---------- centerlines: C# ----------
    var lineTree = new DataTree<Line>();
    
    for( int i = 0; i < lines.BranchCount; ++i )
      for( int j = 1; j < lines.Branch(i).Count - 1; ++j )
      {
      
        if( i % 2 != 0 )
        lineTree.Add( lines.Branch(i)[j], new GH_Path(i) );
        
      }
    
    linesOut = lineTree;
# ---------- end centerlines ----------
leftintersectionrlines = CSharpScript(lines=line_3)  # -> linesOut; inputs lines: tree of Line
# ---------- leftintersectionrlines: C# ----------
    var lineTree = new DataTree<Line>();

    for( int i = 1; i < lines.BranchCount - 1; ++i )
      for( int j = 3; j < lines.Branch(i).Count; ++j )
      {

        if( i % 2 != 1 )
          lineTree.Add(lines.Branch(i)[j], new GH_Path(i));

      }

    linesOut = lineTree;
# ---------- end leftintersectionrlines ----------
rigthintersectionrlines = CSharpScript(lines=line_3)  # -> linesOut; inputs lines: tree of Line
# ---------- rigthintersectionrlines: C# ----------
    var lineTree = new DataTree<Line>();

    for( int i = 1; i < lines.BranchCount - 1; ++i )
      for( int j = 0; j < lines.Branch(i).Count - 3; ++j )
      {

        if( i % 2 != 1 )
          lineTree.Add(lines.Branch(i)[j], new GH_Path(i));

      }

    linesOut = lineTree;
# ---------- end rigthintersectionrlines ----------
leftintersectionrlines_2 = CSharpScript(lines=line_3)  # -> linesOut; inputs lines: tree of Line
# ---------- leftintersectionrlines_2: C# ----------
    var lineTree = new DataTree<Line>();

    for( int i = 0; i < lines.BranchCount; ++i )
      for( int j = 3; j < lines.Branch(i).Count; ++j )
      {

        if( i % 2 != 1 )
          lineTree.Add(lines.Branch(i)[j], new GH_Path(i));

      }

    linesOut = lineTree;
# ---------- end leftintersectionrlines_2 ----------
rigthintersectionrlines_2 = CSharpScript(lines=line_3)  # -> linesOut; inputs lines: tree of Line
# ---------- rigthintersectionrlines_2: C# ----------
    var lineTree = new DataTree<Line>();

    for( int i = 0; i < lines.BranchCount; ++i )
      for( int j = 0; j < lines.Branch(i).Count - 3; ++j )
      {

        if( i % 2 != 1 )
          lineTree.Add(lines.Branch(i)[j], new GH_Path(i));

      }

    linesOut = lineTree;
# ---------- end rigthintersectionrlines_2 ----------
join_curves_3 = JoinCurves(Curves=rigthintersectionrlines, Preserve=False)
join_curves_4 = JoinCurves(Curves=centerlines, Preserve=False)
join_curves_5 = JoinCurves(Curves=rigthintersectionrlines_2, Preserve=False)
join_curves_6 = JoinCurves(Curves=leftintersectionrlines, Preserve=False)
join_curves_7 = JoinCurves(Curves=leftintersectionrlines_2, Preserve=False)
end_points = EndPoints(Curve=join_curves_3)  # -> Start, End
end_points_2 = EndPoints(Curve=join_curves_4)  # -> Start, End
end_points_3 = EndPoints(Curve=join_curves_5)  # -> Start, End
end_points_4 = EndPoints(Curve=join_curves_6)  # -> Start, End
end_points_5 = EndPoints(Curve=join_curves_7)  # -> Start, End
line_21 = Line(StartPoint=end_points_4.Start, EndPoint=end_points_4.End)  # -> simplify(Line)
line_22 = Line(StartPoint=end_points.Start, EndPoint=end_points.End)  # -> simplify(Line)
line_23 = Line(StartPoint=end_points_2.Start, EndPoint=end_points_2.End)  # -> simplify(Line)
line_24 = Line(StartPoint=end_points_5.Start, EndPoint=end_points_5.End)  # -> simplify(Line)
line_25 = Line(StartPoint=end_points_3.Start, EndPoint=end_points_3.End)  # -> simplify(Line)
topbottomlines = CSharpScript(lines=line_3)  # -> linesOut; inputs lines: tree of Line
# ---------- topbottomlines: C# ----------
    var lineTree = new DataTree<Line>();

    for( int i = 0; i < lines.BranchCount; ++i )
      for( int j = 2; j < lines.Branch(i).Count - 2; ++j )
      {

        if( i % 2 != 1 )
          lineTree.Add(lines.Branch(i)[j], new GH_Path(i));

      }

    linesOut = lineTree;
# ---------- end topbottomlines ----------
rightcenterlines = CSharpScript(lines=line_3)  # -> linesOut; inputs lines: tree of Line
# ---------- rightcenterlines: C# ----------
    var lineTree = new DataTree<Line>();

    for( int i = 0; i < lines.BranchCount; ++i )
      for( int j = 0; j < lines.Branch(i).Count - 4; ++j )
      {

        if( i % 2 != 0 )
          lineTree.Add(lines.Branch(i)[j], new GH_Path(i));

      }

    linesOut = lineTree;
# ---------- end rightcenterlines ----------
leftcenterlines = CSharpScript(lines=line_3)  # -> linesOut; inputs lines: tree of Line
# ---------- leftcenterlines: C# ----------
    var lineTree = new DataTree<Line>();

    for( int i = 0; i < lines.BranchCount; ++i )
      for( int j = 4; j < lines.Branch(i).Count; ++j )
      {

        if( i % 2 != 0 )
          lineTree.Add(lines.Branch(i)[j], new GH_Path(i));

      }

    linesOut = lineTree;
# ---------- end leftcenterlines ----------
list_item_14 = ListItem(List=flip_matrix_6, Index=0, Wrap=True)
list_item_15 = ListItem(List=flip_matrix_7, Index=1, Wrap=True)
list_item_16 = ListItem(List=flip_matrix_8, Index=0, Wrap=True)
list_item_17 = ListItem(List=flip_matrix_9, Index=1, Wrap=True)

pickarowwithoutloosingbranch_10 = CSharpScript(tree=point_attraction.Grid, branch=Slider(0, range=0..100))  # -> selected; inputs tree: tree of Point3d, branch: Int32; same code as pickarowwithoutloosingbranch
cull_pattern_7 = CullPattern(List=pickarowwithoutloosingbranch_10, CullPattern=[True, False, True, True, False])
join_curves_8 = JoinCurves(Curves=flatten(list_item_13), Preserve=False)
curve_closest_point_3 = CurveClosestPoint(Point=cull_pattern_7, Curve=join_curves_8)  # -> Point, Parameter, Distance
topbottomlines_2 = CSharpScript(lines=line_3)  # -> linesOut; inputs lines: tree of Line
# ---------- topbottomlines_2: C# ----------
    var lineTree = new DataTree<Line>();

    for( int i = 1; i < lines.BranchCount - 1; ++i )
      for( int j = 2; j < lines.Branch(i).Count - 2; ++j )
      {

        if( i % 2 != 1 )
          lineTree.Add(lines.Branch(i)[j], new GH_Path(i));

      }

    linesOut = lineTree;
# ---------- end topbottomlines_2 ----------
shatter_3 = Shatter(Curve=join_curves_8, Parameters=curve_closest_point_3.Parameter)

# ---- group: MeshConstruction
curve_2 = Curve([list_item_14, list_item_15, list_item_16, list_item_17, leftcenterlines, rightcenterlines, topbottomlines, list_item_10, list_item_12])
curve_3 = Curve([line_23, line_24, line_25])
curve_4 = Curve([curve_3, curve_2])
weaverbird_s_mesh_from_lines_weave_back = WeaverbirdsMeshFromLinesWeaveBack(Lines=flatten(curve_4), MaximumValence=Slider(4, range=0..10))

# ----
angle = Panel("-pi")
angle_2 = Panel("pi")

# ---- group: SimulationReset
reset = Button()
toggle = BooleanToggle(False)

# ---- group: mesh of flat folding pattern
mesh = Mesh(weaverbird_s_mesh_from_lines_weave_back)

# ----
folding = Slider(0.623, range=0..0.99)

# ---- group: KangarooOne
curve_5 = Curve([line_23, line_21, line_22])
curve_6 = Curve([list_item_11, list_item_13, list_item_12, list_item_10, list_item_14, list_item_15, list_item_16, list_item_17, leftcenterlines, rightcenterlines, topbottomlines])
valleys = Curve(flatten(curve_5))
mountains = Curve(flatten(curve_6))
origami = Origami(mesh=weaverbird_s_mesh_from_lines_weave_back, C=valleys, num_4=angle, C_2=mountains, num_2=angle_2, num=folding)  # -> data_2, R
timer = Timer(TimerInterval=20, Target=kangaroophysics)
kangaroophysics = KangarooPhysics(ForceObjects=origami.data_2, Settings=null, Geometry=origami.R, SimulationReset=Toggle(True))  # -> Out, Iterations, ParticlesOut, GeometryOut, KE
mesh_2 = Mesh(kangaroophysics.GeometryOut)

# ----
hingepoints = HingePoints(Mesh=mesh)  # -> _1, _2, _3, _4
end_points_6 = EndPoints(Curve=join_curves)  # -> Start, End
end_points_7 = EndPoints(Curve=join_curves_2)  # -> Start, End

# ---- group: maintain edge lengths
medges = MeshEdges(Mesh=mesh)  # -> NakedEdges, InteriorEdges, NonManifoldEdges
length_line = LengthLine(Line=[medges.NakedEdges, medges.InteriorEdges], Strength=1)

# ---- group: a weak plastic anchor on all points prevents drift
demesh = DeconstructMesh(Mesh=mesh)  # -> Vertices, Faces, Colours, Normals
plasticanchor = PlasticAnchor(Point=demesh.Vertices, Limit=0.1, Strength=0.01)

# ---- group: AnchorPointsAlthoughWeDontNeedThemNoMore
join_curves_9 = JoinCurves(Curves=line_24, Preserve=False)
join_curves_10 = JoinCurves(Curves=line_25, Preserve=False)
end_points_8 = EndPoints(Curve=join_curves_9)  # -> Start, End
end_points_9 = EndPoints(Curve=join_curves_10)  # -> Start, End
point_12 = Point(end_points_8.End)
point_13 = Point(end_points_9.Start)

# ---- group: WeShouldntNeedThisOnes
load = Load(ForceVector=Vector(0, 0, 1))
point_14 = Point([point_12, point_13])
move_10 = Move(Geometry=graft(point_14), Motion=Vector(0, 0, 10))  # -> Geometry, Transform
anchor = Anchor(Point=flatten(move_10.Geometry), Strength=1000)

# ----
curve_7 = Curve([list_item_14, list_item_15, list_item_16, list_item_17, leftcenterlines, rightcenterlines, shatter, shatter_2, list_item_10, list_item_12, topbottomlines_2])
curve_8 = Curve([line_23, line_21, line_22])
valleys_2 = Curve(flatten(curve_8))
mountains_2 = Curve(flatten(curve_7))
folding_2 = Slider(0, range=0..0.99)
rad = Radians(Degrees=Slider(-180, range=-360..360))
rad_2 = Radians(Degrees=Slider(45, range=-360..360))
hingepoints_2 = HingePoints(Mesh=mesh)  # -> _1, _2, _3, _4
multiplication = Multiplication(A=angle_2, B=folding_2)
multiplication_2 = Multiplication(A=angle, B=folding_2)
ln = Line(StartPoint=hingepoints._1, EndPoint=hingepoints._2)
hinge = Hinge(
    FoldStart=hingepoints._1,
    FoldEnd=hingepoints._2,
    Tip1=hingepoints._3,
    Tip2=hingepoints._4,
    RestAngle=expr("-x", multiplication),
    Strength=0.1)
hinge_2 = Hinge(
    FoldStart=hingepoints._1,
    FoldEnd=hingepoints._2,
    Tip1=hingepoints._3,
    Tip2=hingepoints._4,
    RestAngle=expr("-x", multiplication_2),
    Strength=0.1)
show = Show(G=mesh)
eval = EvaluateCurve(Curve=ln, Parameter=0.5)  # -> graft(Point), Tangent, Angle

# ---- group: Mountain fold lines
crv = Curve(mountains_2)

# ---- group: Valley fold lines
crv_2 = Curve(valleys_2)

# ----
eval_2 = EvaluateCurve(Curve=reparameterize(crv_2), Parameter=0.5)  # -> Point, Tangent, Angle
eval_3 = EvaluateCurve(Curve=reparameterize(crv), Parameter=0.5)  # -> Point, Tangent, Angle
dist = Distance(PointA=eval_2.Point, PointB=eval.Point)
dist_2 = Distance(PointA=eval_3.Point, PointB=eval.Point)
sort = SortList(Keys=dist)  # -> Keys, ValuesA
sort_2 = SortList(Keys=dist_2)  # -> Keys, ValuesA
item = ListItem(List=sort.Keys, Index=0, Wrap=True)
item_2 = ListItem(List=sort_2.Keys, Index=0, Wrap=True)
smaller = SmallerThan(FirstNumber=item, SecondNumber=0.01)  # -> flatten(SmallerThan), OrEqualTo
smaller_2 = SmallerThan(FirstNumber=item_2, SecondNumber=0.01)  # -> flatten(SmallerThan), OrEqualTo
cull = CullPattern(List=hinge_2, CullPattern=smaller.SmallerThan)
cull_2 = CullPattern(List=hinge, CullPattern=smaller_2.SmallerThan)

# ---- group: Output
solver = Solver(GoalObjects=[length_line, cull, cull_2, show, plasticanchor], Reset=reset, Threshold=1e-15, Tolerance=0.01, On=toggle)  # -> I, V, O
onlymeshes = CSharpScript(x=solver.O)  # -> out, A; inputs x: tree
# ---------- onlymeshes: C# ----------
    var meshOut = new List<object>();

    for( int i = 0; i < x.BranchCount; ++i )
      for( int j = 0; j < x.Branch(i).Count; ++j )
      {
  
        if( x.Branch(i)[j] != null )
          
          if( x.Branch(i)[j].GetType() == typeof( Rhino.Geometry.Mesh ) )
        
            meshOut.Add(x.Branch(i)[j]);
  
      }

    A = meshOut;
# ---------- end onlymeshes ----------

# ==== cluster Origami: Fold a flat pattern into 3d origami
mesh = ClusterInput()
mesh_2 = Mesh(mesh)
num = ClusterInput()
num_2 = ClusterInput()
hingepoints = HingePoints(Mesh=mesh_2)  # -> _1, _2, _3, _4
strength = Panel("1")
num_3 = Number(num)
C = ClusterInput()
C_2 = ClusterInput()
num_4 = ClusterInput()
strength_2 = Panel("1")
num_5 = Number(num_2)
num_6 = Number(strength)
eval = EvaluateCurve(Curve=reparameterize(C), Parameter=0.5)  # -> Point, Tangent, Angle
eval_2 = EvaluateCurve(Curve=reparameterize(C_2), Parameter=0.5)  # -> Point, Tangent, Angle
ln = Line(StartPoint=hingepoints._1, EndPoint=hingepoints._2)
num_7 = Number(num_4)
num_8 = Number(strength_2)
tri = Triangulate(Mesh=mesh_2)  # -> Mesh, Count
multiplication = Multiplication(A=num_7, B=num_3)
multiplication_2 = Multiplication(A=num_5, B=num_3)
eval_3 = EvaluateCurve(Curve=reparameterize(ln), Parameter=0.5)  # -> graft(Point), Tangent, Angle
springsfrommesh = SpringsFromMesh(M=tri.Mesh, stiffness=100, B=1)
planarizequads = PlanarizeQuads(M=mesh_2, planarizestrength=1000)
unweld = UnweldMesh(Mesh=mesh_2, Angle=0)
cp = ClosestPoint(Point=eval_3.Point, Cloud=eval_2.Point)  # -> ClosestPoint, CPIndex, Distance
cp_2 = ClosestPoint(Point=eval_3.Point, Cloud=eval.Point)  # -> ClosestPoint, CPIndex, Distance
R = ClusterOutput(unweld)
larger = LargerThan(FirstNumber=0.01, SecondNumber=cp.Distance)  # -> LargerThan, OrEqualTo
larger_2 = LargerThan(FirstNumber=0.01, SecondNumber=cp_2.Distance)  # -> LargerThan, OrEqualTo
cull = CullPattern(List=num_8, CullPattern=larger_2.LargerThan)
cull_2 = CullPattern(List=multiplication, CullPattern=larger_2.LargerThan)
cull_3 = CullPattern(List=num_6, CullPattern=larger.LargerThan)
cull_4 = CullPattern(List=multiplication_2, CullPattern=larger.LargerThan)
addition = Addition(A=cull, B=cull_3)
addition_2 = Addition(A=cull_2, B=cull_4)
addition_3 = Addition(A=0, B=addition)  # -> flatten(Result)
addition_4 = Addition(A=0, B=addition_2)  # -> flatten(Result)
hinge = Hinge(
    Point1=hingepoints._1,
    Point2=hingepoints._2,
    Point3=hingepoints._3,
    Point4=hingepoints._4,
    Strength=addition_3,
    RestAngle=addition_4)
data = Data([springsfrommesh, hinge, planarizequads])
data_2 = ClusterOutput(data)

# ==== cluster PlanarizeQuads: Applies a planarization force to any quads in a mesh
M = ClusterInput()
mcomp = Decompose(Mesh=M)  # -> Vertices, Faces, Colours, Normals
vertices = FaceVertices(Face=mcomp.Faces)  # -> CornerA, CornerB, CornerC, CornerD
planarizestrength = ClusterInput()
item = ListItem(List=mcomp.Vertices, Index=vertices.CornerA, Wrap=False)
item_2 = ListItem(List=mcomp.Vertices, Index=vertices.CornerB, Wrap=False)
item_3 = ListItem(List=mcomp.Vertices, Index=vertices.CornerC, Wrap=False)
item_4 = ListItem(List=mcomp.Vertices, Index=vertices.CornerD, Wrap=False)
planarize = Planarize(Point1=item, Point2=item_2, Point3=item_3, Point4=item_4, PlanarizeStrength=planarizestrength)
equals = Equality(FirstNumber=vertices.CornerC, SecondNumber=vertices.CornerD)  # -> Equality, Inequality
cull = CullPattern(List=planarize, CullPattern=equals.Inequality)
L = ClusterOutput(cull)

# ==== cluster SpringsFromMesh: Turns all edges of a mesh into springs
M = ClusterInput()
medges = MeshEdges(Mesh=M)  # -> NakedEdges, InteriorEdges, NonManifoldEdges
crv = Curve([medges.NakedEdges, medges.InteriorEdges])
B = ClusterInput()
len = Length(Curve=crv)
multiplication = Multiplication(A=len, B=B)
stiffness = ClusterInput()
springs = SpringsFromLine(Connection=crv, Stiffness=stiffness, Damping=10, RestLength=multiplication, UpperCutoff=0, LowerCutoff=0, Plasticity=0)
S = ClusterOutput(springs)
